# Grasshopper definition Create views of Model.gh (Grasshopper 1.0.7)
# plug-ins: horsterCameraControl

number_slider = Slider(1, range=0..1)
rectangle = Rectangle(Plane=PlaneXY(0, 0, 0), XSize=number_slider, YSize=number_slider, Radius=0)  # -> Rectangle, Length
boxrec = BoxRectangle(Rectangle=rectangle.Rectangle, Height=number_slider)
series = Series(Start=0, Step=1, Count="12")
filedge = FilletEdge(Shape=boxrec, Blend=0, Metric=0, Edges=series, Radii=expr("x*.1", number_slider))
number_slider_2 = Slider(100, range=0..100)
demesh = DeconstructMesh(Mesh=filedge)  # -> Vertices, Faces, Colours, Normals
conmesh = ConstructMesh(Vertices=demesh.Vertices, Faces=demesh.Faces, Colours=demesh.Normals)
crv = Curve(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)
crv_2 = Curve(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)
number_slider_3 = Slider(99, range=0..99)
divide = DivideCurve(Curve=crv, Count=number_slider_2, Kinks=False)  # -> Points, Tangents, Parameters
divide_2 = DivideCurve(Curve=crv_2, Count=number_slider_2, Kinks=False)  # -> Points, Tangents, Parameters
item = ListItem(List=divide.Points, Index=number_slider_3, Wrap=True)
item_2 = ListItem(List=divide_2.Points, Index=number_slider_3, Wrap=True)
setcam = SetCamera(CameraLocation=item, TargetLocation=item_2, Activate="True")
animcamera = AnimateCamera(SaveCameraState=False, Reset=False)
