# Grasshopper definition Table Creation.gh (Grasshopper 1.0.7)
# plug-ins: Pufferfish

table_height = Slider(3.5, range=1.5..10)
table_radius = Slider(5, range=1.5..10)
of_sides = Slider(5, range=3..6)
table_thickness = Slider(0.25, range=0.05..0.25)
corner_fillet = Slider(0.41, range=0..1)
edge_fillet = Slider(0.04, range=0.01..0.15)
leg_radius = Slider(0.2, range=0.1..0.5)
legs_skew = Slider(1.25, range=0.75..1.25)
bottom_taper = Slider(0.5, range=0.5..1)
pt = ConstructPoint(XCoordinate=0, YCoordinate=0, ZCoordinate=table_height)
polygon = Polygon(Plane=pt, Radius=table_radius, Segments=of_sides, FilletRadius=0)  # -> Polygon, Length
neg = Negative(Value=table_thickness)
offset = OffsetCurve(Curve=polygon.Polygon, Distance="-0.75", Corners=1)
Z = UnitZ(Factor=neg)
fillet = Fillet(Curve=polygon.Polygon, Radius=corner_fillet)
extr = Extrude(Base=fillet, Direction=Z)
explode = Explode(Curve=offset, Recursive=True)  # -> Segments, Vertices
cap = CapHoles(Brep=extr)
lng = ListLength(List=explode.Vertices)  # -> expr("x-1", Length)
edges = BrepEdges(Brep=cap)  # -> Naked, Interior, NonManifold
area = Area()  # -> Area, Centroid
cull_i = CullIndex(List=explode.Vertices, Indices=lng, Wrap=True)
panel = Panel(edges.Interior)
cir = Circle(Plane=cull_i, Radius=leg_radius)
move = Move(Geometry=cir, Motion=Z)  # -> Geometry, Transform
mindex = MemberIndex(Set=panel, Member="Closed Planar Curve")  # -> Index, Count
pdecon = Deconstruct(Point=move.Geometry)  # -> XComponent, YComponent, ZComponent
Z_2 = UnitZ(Factor=expr("-x", pdecon.ZComponent))
filedge = FilletEdge(Shape=cap, Blend=0, Metric=0, Edges=mindex.Index, Radii=edge_fillet)
preview = CustomPreview(
    Geometry=filedge,
    Material={diffuse=RGB(221, 160, 221), emission=RGB(66, 48, 66), shine=0.5, specular=RGB(255, 255, 255), transparency=0})
area_2 = Area(Geometry=move.Geometry)  # -> Area, Centroid
move_2 = Move(Geometry=move.Geometry, Motion=Z_2)  # -> Geometry, Transform
area_3 = Area(Geometry=move_2.Geometry)  # -> Area, Centroid
scale = Scale(Geometry=area_3.Centroid, Center=Point(0, 0, 0), Factor=legs_skew)  # -> Geometry, Transform
move2pt = MoveToPoint(Geometry=move.Geometry, PointA=area_2.Centroid, PointB=scale.Geometry)  # -> Moved, Vector, Transform
area_4 = Area(Geometry=move2pt.Moved)  # -> Area, Centroid
scale_2 = Scale(Geometry=move2pt.Moved, Center=area_4.Centroid, Factor=bottom_taper)  # -> Geometry, Transform
rulesrf = RuledSurface(CurveA=move.Geometry, CurveB=scale_2.Geometry)
cap_2 = CapHoles(Brep=rulesrf)
preview_2 = CustomPreview(
    Geometry=cap_2,
    Material={diffuse=RGB(221, 160, 221), emission=RGB(66, 48, 66), shine=0.5, specular=RGB(255, 255, 255), transparency=0})
