# Grasshopper definition Table Creation.gh (Grasshopper 1.0.7)
# plug-ins: Pufferfish, VoxelTools

table_height = Slider(3.5, range=1.5..10)
of_sides = Slider(5, range=3..6)
leg_radius = Slider(0.2, range=0.1..0.5)
table_radius = Slider(5, range=1.5..10)
table_thickness = Slider(0.25, range=0.05..0.25)
corner_fillet = Slider(0.41, range=0..1)
edge_fillet = Slider(0.04, range=0.01..0.15)
legs_skew = Slider(1.25, range=0.75..1.25)
bottom_taper = Slider(0.5, range=0.5..1)
concat = Concatenate(FragmentA=table_height, FragmentB=" ft, ")
concat_2 = Concatenate(FragmentA=table_radius, FragmentB=" ft, ")
concat_3 = Concatenate(FragmentA=table_thickness, FragmentB=" in. ")
concat_4 = Concatenate(
    FragmentA="Create a Table with ",
    FragmentC=of_sides,
    FragmentG=" sides, ",
    FragmentH="a height of ",
    FragmentB=concat,
    FragmentD="a radius of ",
    FragmentE=concat_2,
    FragmentF="and a thickness of ",
    FragmentI=concat_3)
panel = Panel(concat_4)

# ----
# Table Top
pt = ConstructPoint(XCoordinate=0, YCoordinate=0, ZCoordinate=table_height)
polygon = Polygon(Plane=pt, Radius=table_radius, Segments=of_sides, FilletRadius=0)  # -> Polygon, Length
fillet = Fillet(Curve=polygon.Polygon, Radius=corner_fillet)
explode = Explode(Curve=polygon.Polygon, Recursive=True)  # -> Segments, Vertices
ln = Line(StartPoint=pt, EndPoint=explode.Vertices)
neg = Negative(Value=table_thickness)
Z = UnitZ(Factor=neg)
ccx = CurveCurve(CurveA=ln, CurveB=fillet)  # -> Points, ParamsA, ParamsB
extr = Extrude(Base=fillet, Direction=Z)
move = Move(Geometry=ccx.Points, Motion=expr("x/2", Z))  # -> Geometry, Transform
cap = CapHoles(Brep=extr)
pt_2 = Point(move.Geometry)
edges = BrepEdges(Brep=cap)  # -> Naked, Interior, NonManifold
panel_2 = Panel(edges.Interior)
mindex = MemberIndex(Set=panel_2, Member="Closed Planar Curve")  # -> Index, Count
filedge = FilletEdge(Shape=cap, Blend=0, Metric=0, Edges=mindex.Index, Radii=edge_fillet)
area = Area(Geometry=filedge)  # -> Area, Centroid
preview = CustomPreview(Geometry=filedge, Material=ColourSwatch(SwatchColor=RGBA(255, 186, 186, 121)))
pt_3 = Point(area.Centroid)

# ----
# Legs
panel_3 = Panel("-0.75")
offset = OffsetCurve(Curve=polygon.Polygon, Distance=panel_3, Corners=1)
explode_2 = Explode(Curve=offset, Recursive=True)  # -> Segments, Vertices
lng = ListLength(List=explode_2.Vertices)  # -> expr("x-1", Length)
cull_i = CullIndex(List=explode_2.Vertices, Indices=lng, Wrap=True)
cir = Circle(Plane=cull_i, Radius=leg_radius)
move_2 = Move(Geometry=cir, Motion=Z)  # -> Geometry, Transform
pdecon = Deconstruct(Point=move_2.Geometry)  # -> XComponent, YComponent, ZComponent
area_2 = Area(Geometry=move_2.Geometry)  # -> Area, Centroid
Z_2 = UnitZ(Factor=expr("-x", pdecon.ZComponent))
pt_4 = Point(area_2.Centroid)
move_3 = Move(Geometry=move_2.Geometry, Motion=Z_2)  # -> Geometry, Transform
area_3 = Area(Geometry=move_3.Geometry)  # -> Area, Centroid
area_4 = Area(Geometry=move_2.Geometry)  # -> Area, Centroid
scale = Scale(Geometry=area_3.Centroid, Center=Point(0, 0, 0), Factor=legs_skew)  # -> Geometry, Transform
move2pt = MoveToPoint(Geometry=move_2.Geometry, PointA=area_4.Centroid, PointB=scale.Geometry)  # -> Moved, Vector, Transform
area_5 = Area(Geometry=move2pt.Moved)  # -> Area, Centroid
scale_2 = Scale(Geometry=move2pt.Moved, Center=area_5.Centroid, Factor=bottom_taper)  # -> Geometry, Transform
pt_5 = Point(area_5.Centroid)
rulesrf = RuledSurface(CurveA=move_2.Geometry, CurveB=scale_2.Geometry)
cap_2 = CapHoles(Brep=rulesrf)
preview_2 = CustomPreview(Geometry=cap_2, Material=ColourSwatch(SwatchColor=RGBA(84, 84, 84, 121)))

merge = Merge(Data1=filedge, Data2=cap_2)  # disabled
bbox = BoundingBox(Content=flatten(merge), Plane=PlaneXY(0, 0, 0), UnionBox=True)  # -> Box, Box_2
area_6 = Area(Geometry=bbox.Box)  # -> Area, Centroid
number_slider = Slider(0.1, range=0..1)
scale_nu = ScaleNU(Geometry=bbox.Box, Plane=area_6.Centroid, ScaleX=1.15, ScaleY=1.15, ScaleZ=1.15)  # -> Geometry, Transform
sunion = SolidUnion(Breps=flatten(merge))
voxcreate = CreateVoxelGrid(BoundingBox=scale_nu.Geometry, SizeX=number_slider, SizeY=number_slider, SizeZ=number_slider)
voxgeo = VoxelateGeometry(Geometry=flatten(sunion), VoxelGrid=voxcreate, Distance=0)
voxbox = VoxelGridToBoxes(VoxelGrid=voxgeo, Selection=-1)  # -> Boxes, Points
pt_6 = Point(voxbox.Points)
brepinc = PointInBrep(Brep=sunion, Point=pt_6, Strict=False)
cull = CullPattern(List=voxbox.Boxes, CullPattern=brepinc)
