# Grasshopper definition Thesis Working Folder - 3D Diffusion.gh (Grasshopper 1.0.7)

# ---- group: Initial Box
number_slider = Slider(2, range=0..10)
expression = Expression(x=number_slider, Expression="X/2")
neg = Negative(Value=expression)
dom = ConstructDomain(DomainStart=neg, DomainEnd=expression)
rectangle = Rectangle(Plane=PlaneXY(0, 0, 0), XSize=dom, YSize=dom, Radius=0)  # -> Rectangle, Length
boxrec = BoxRectangle(Rectangle=rectangle.Rectangle, Height=number_slider)

# ----
scale = Slider(100, range=0..1000)
expression_2 = Expression(x=Slider(1000, range=0..2000), Expression="X/1000")
expression_3 = Expression(x=Slider(1500, range=0..2000), Expression="X/1000")
expression_4 = Expression(x=Slider(1000, range=0..2000), Expression="X/1000")
expression_5 = Expression(x=Slider(20, range=0..2000), Expression="X/1000")
expression_6 = Expression(x=Slider(100, range=0..2000), Expression="X/1000")
expression_7 = Expression(x=Slider(60, range=0..2000), Expression="X/1000")
expression_8 = Expression(x=Slider(60, range=0..2000), Expression="X/1000")
expression_9 = Expression(x=expression_2, Expression="X/2")
expression_10 = Expression(x=expression_3, Expression="X/2")
expression_11 = Expression(x=expression_7, Expression="X/2")
expression_12 = Expression(x=expression_8, Expression="X/2")
neg_2 = Negative(Value=expression_9)
neg_3 = Negative(Value=expression_10)
neg_4 = Negative(Value=expression_11)
neg_5 = Negative(Value=expression_12)
dom_2 = ConstructDomain(DomainStart=neg_2, DomainEnd=expression_9)
dom_3 = ConstructDomain(DomainStart=neg_3, DomainEnd=expression_10)
dom_4 = ConstructDomain(DomainStart=neg_4, DomainEnd=expression_11)
dom_5 = ConstructDomain(DomainStart=neg_5, DomainEnd=expression_12)
box = EvaluateBox(Box=boxrec, UParameter="0", VParameter="0", WParameter="0")  # -> Plane, Point, Include
debox = DeconstructBox(Box=boxrec)  # -> Plane, X, Y, Z
multiplication = Multiplication(A=number_slider, B=scale)
rectangle_2 = Rectangle(Plane=PlaneXY(0, 0, 0), XSize=dom_2, YSize=dom_3, Radius=0)  # -> Rectangle, Length
Z = UnitZ(Factor=expression_5)
neg_6 = Negative(Value=expression_6)
Z_2 = UnitZ(Factor=expression_4)
num = Number(debox.X)
num_2 = Number(debox.Y)
num_3 = Number(debox.Z)
division = Division(A=num, B=multiplication)
division_2 = Division(A=num_2, B=multiplication)
division_3 = Division(A=num_3, B=multiplication)
move = Move(Geometry=rectangle_2.Rectangle, Motion=Z_2)  # -> Geometry, Transform
box_2 = DomainBox(Base=box.Plane, X=division, Y=division_2, Z=division_3)
volume = Volume(Geometry=box_2)  # -> Volume, Centroid
srf = Surface(move.Geometry)
neg_7 = Negative(Value=Z)
arrbox = BoxArray(Geometry=volume.Centroid, Cell=box_2, XCount=multiplication, YCount=multiplication, ZCount=multiplication)  # -> Geometry, Transform
move_2 = Move(Geometry=move.Geometry, Motion=neg_7)  # -> Geometry, Transform
extr = Extrude(Base=srf, Direction=neg_7)
offset = OffsetCurve(Curve=move_2.Geometry, Distance=neg_6, Corners=1)
disc = Discontinuity(Curve=offset, Level=1)  # -> Points, Parameters
subtraction = Subtraction(A=expression_4, B=expression_5)
rectangle_3 = Rectangle(Plane=disc.Points, XSize=dom_4, YSize=dom_5, Radius=0)  # -> Rectangle, Length
Z_3 = UnitZ(Factor=subtraction)
srf_2 = Surface(rectangle_3.Rectangle)
neg_8 = Negative(Value=Z_3)
extr_2 = Extrude(Base=srf_2, Direction=neg_8)
merge = Merge(Data1=extr, Data2=extr_2)  # -> flatten(Result)
sunion = SolidUnion(Breps=merge)
geo = Geometry(sunion)
brepinc = PointInBrep(Brep=geo, Point=arrbox.Geometry, Strict=False)
cull = CullPattern(List=arrbox.Geometry, CullPattern=brepinc)
vec2pt = Vector2Pt(PointA=volume.Centroid, PointB=cull, Unitize=False)  # -> Vector, Length
move_3 = Move(Geometry=box_2, Motion=vec2pt.Vector)  # -> Geometry, Transform
